% Simulink data dictionary StateMachine.sldd

VehicleState = enum(DefaultValue="Default", StorageType="uint8", AddClassNameToEnumNames=true)
  Default = 0
  Precharge = 1
  PrechargeComplete = 2
  ReadyToMove = 3
  PrechargeFault = 4
  WeldedContactor = 5
  ReadyToMoveFault = 6

ContactorFault = enum(DefaultValue="NoFault", StorageType="int8")
  NoFault = 0
  PrechargeFault = 1
  WeldedContactor = 2
  ReadyToMoveFault = 3

InverterStatus = enum(DefaultValue="Off", StorageType="uint8", AddClassNameToEnumNames=true)
  Off = 0
  On = 1

DCDCStatus = enum(DefaultValue="Off", StorageType="uint8", AddClassNameToEnumNames=true)
  Off = 0
  On = 1