% Simulink data dictionary TorqueCommand.sldd

TorqueCurve = enum(DefaultValue="Default", StorageType="int8")
  Default = 0
  Matt = 1  % Curve for Matt's Preference
  Casey = 2  % Curve for Casey's Preference
  Noah = 3  % Curve for Noah's Preference
  Carter = 4  % Curve for Carter's Preference
  Lim150 = 5  % Copped at 150Nm
  Lim100 = 6  % Capped at 100Nm

TCEnable = enum(DefaultValue="TCOff")
  TCOff = 0
  TCOn = 1

RegenEnable = enum(DefaultValue="RegOff", StorageType="int8")
  RegOff = 0
  RegOn = 1

TorqueProfile = enum(DefaultValue="Player1", StorageType="int8")
  Player1 = 0
  Driver1 = 1
  Driver2 = 2
  Driver3 = 3
  Driver4 = 4
  Testing1 = 5
  Testing2 = 6
  Testing3 = 7
  Testing4 = 8
  Testing5 = 9
  Testing6 = 10

TorqueCeiling = enum(DefaultValue="NA")
  NA = 0
  OverCurr = 1
  UnderVoltage = 2

TorqueKiLowerSat = Simulink.Parameter(0, DataType="single", Unit="Nm")
TorqueKiUpperSat = Simulink.Parameter(125, DataType="single", Unit="Nm")