% Simulink data dictionary SR26.sldd
% references Utilities.sldd
% references ThrottlePosition.sldd
% references IO.sldd
% references BrakePressure.sldd
% references BSPD.sldd
% references APPS_BSPC.sldd
% references DCDC.sldd
% references StateMachine.sldd
% references PM100DX.sldd
% references VehicleDynamics.sldd
% references TorqueCommand.sldd

dt = Simulink.Parameter(10, DataType="single", Unit="ms")  % Model runtime

TorqueState = enum(DefaultValue="State0", StorageType="uint8")
  State0 = 0  % 100Nm
  State1 = 1  % 120Nm
  State2 = 2  % 140Nm
  State3 = 3  % 160Nm
  State4 = 4  % 180Nm
  State5 = 5  % 200Nm