% Simulink data dictionary DCDC.sldd

DCDCFaultState = enum(DefaultValue="Fault", StorageType="uint8", AddClassNameToEnumNames=true)
  Normal = 0
  Fault = 1

DCDCStatus = enum(DefaultValue="Off", StorageType="uint8", AddClassNameToEnumNames=true)
  Off = 0
  On = 1