% Simulink data dictionary Utilities.sldd

StateSignal = enum(DefaultValue="Fault", StorageType="uint8", AddClassNameToEnumNames=true)
  Fault = 0
  Normal = 1

StateCAN = enum(DefaultValue="Normal", StorageType="uint8", AddClassNameToEnumNames=true)  % Enumerated CAN states
  Normal = 0
  NotReceived = 1
  TimedOut = 2
  NA = 3